vi "webvipolyfill.gviweb"   [LabVIEW NXG 2.1.0]
inputs:
  "action": string, required
  "input": string
  "error in": error
outputs:
  "output": string
  "error out": error
uses:
  NI::HTTP::POST Buffer.gvi
  NI::G Core::Error::Is Error.gvi
  NI::G Core::Error::Build Error Cluster.gvi
diagram:
  Concatenate Strings("webvipolyfill:", $action) -> w1
  call "POST Buffer.gvi"(timeout=-1, client handle=0, url=w1, buffer=$input, error in=$"error in", output file=path constant) -> (status code=w2, body=w3, error out=w4)
  $output <- w3
  case (w2) {
    frame Default {
      w7 = 0  # no error
      w5 = w7
      w6 = ""
    }
    frame 44300 {
      w8 = "An exception occurred invoking the external JavaScript function ("
      Concatenate Strings(w8, $action, ") with the following input (", $input, ").") -> w6
      w5 = w2
    }
    frame 44302 {
      Concatenate Strings("The JavaScript function (", $action, ") could not be found") -> w6
      w5 = w2
    }
    frame 44304 {
      Concatenate Strings("Invalid return type from JavaScript function (", $action, ") invoked with input (", $input, "). Must return a JavaScript String.") -> w6
      w5 = w2
    }
  }
  w9 = "Error attempting to invoke the webvipolyfill library. Make sure webvipolyfill.js is added to your Web Application component and as a script tag in the HTML of your Top-Level gviweb."
  w10 = 10000  # error
  w11 = 0  # no error
  call "Is Error.gvi"(error in=w4) -> (error?=w12)
  Select(s=w12, t=w10, f=w11) -> w13
  call "Build Error Cluster.gvi"(error in=no error, code=w13, description=w9, include call chain=TRUE, make warning=FALSE) -> (error out=w14)
  To Long Integer(number=w5) -> w15
  call "Build Error Cluster.gvi"(error in=w14, code=w15, description=w6, include call chain=TRUE, make warning=FALSE) -> (error out=w16)
  $"error out" <- w16
